% Simulink data dictionary rev3_data.sldd

UC_State = enum(DefaultValue="MC_Off")
  MC_Off = 0
  MC_Init = 1
  Contactor_Closed = 2
  MC_Active = 3
  Contactor_Open = 4
  MC_Discharging = 5
  Fault = 6
  Estop = 7
  Preset = 8
  LVSS_MC_Startup = 9
  LVSS_MC_Shutdown = 10

MC_DC_State = enum(DefaultValue="Disabled")
  Disabled = 0
  Enabled = 1
  Speed_Check = 2
  Active = 3
  Complete = 4

MC_VSM_State = enum(DefaultValue="Start")
  Start = 0
  PC_Init = 1
  PC_Active = 2
  PC_Finish = 3
  Wait = 4
  Ready = 5
  Motor_Running = 6
  Fault = 7
  Shutdown = 14
  Recycle_Power = 15

Rider_Input = Simulink.Bus()
  Key_In: boolean
  Estop_In: boolean
  Brake: boolean
  Forward_EN: boolean
  Start: boolean
  Throttle: int16

Fault_Input = Simulink.Bus()
  Force_WD_Low: boolean
  Force_Estop_Low: boolean
  Force_UC_State_3: boolean
  Force_Ignition_High: boolean

LVSS_Feedback_Output = Simulink.Bus()
  LVSS_ON: boolean

MC_Feedback_Output = Simulink.Bus()
  D1_VSM_State: uint8
  D4_Inverter_Discharge_State: uint8

VCU_Feedback_Input = Simulink.Bus()
  MC_Feedback: Bus: MC_Feedback_Output
  LVSS_Feedback: Bus: LVSS_Feedback_Output

MC_Command = Simulink.Bus()
  Direction_Command: boolean
  Rolling_Counter: uint8
  Speed_Command: int16
  Speed_Mode_Enable: boolean
  Torque_Limit_Command: uint16
  Inverter_Enable: boolean
  Inverter_Discharge: boolean
  Torque_Command: int16

VCU_MC_Outputs = Simulink.Bus()
  MC_Command: Bus: MC_Command
  MC_12V0: boolean
  Fault_To_MC: boolean

VCU_LVSS_Outputs = Simulink.Bus()
  LVSS_EN: boolean

VCU_Outputs = Simulink.Bus()
  MC_Outputs: Bus: VCU_MC_Outputs
  LVSS_Outputs: Bus: VCU_LVSS_Outputs